# Grasshopper definition Dijkstra+Wallacei.gh (Grasshopper 1.0.7)
# plug-ins: Kangaroo2 Components, Heteroptera, Shortest Walk in Gh, Wallacei

# ---- group: 1读取mesh 提取边线
mesh = Mesh(<mesh referenced from the Rhino model>)
mesh_edges = MeshEdges(Mesh=mesh)  # -> NakedEdges, InteriorEdges, NonManifoldEdges
line = Line(mesh_edges.InteriorEdges)

# ---- group: 2提取三角形边线并去重作为计算路径
removeduplicatelines = RemoveDuplicateLines(Lines=flatten(line), Tolerance="0.1")

# ----
length = Length(Curve=removeduplicatelines)
list_item = ListItem(List=removeduplicatelines, Index=Slider(1, range=0..10), Wrap=True)

# ---- group: 3构造所有路径的水平投影线，从而计算得到坡度夹角
end_points = EndPoints(Curve=removeduplicatelines)  # -> Start, End
deconstruct = Deconstruct(Point=end_points.Start)  # -> XComponent, YComponent, ZComponent
deconstruct_2 = Deconstruct(Point=end_points.End)  # -> XComponent, YComponent, ZComponent
construct_point = ConstructPoint(XCoordinate=deconstruct_2.XComponent, YCoordinate=deconstruct_2.YComponent, ZCoordinate=deconstruct.ZComponent)
line_2 = Line(StartPoint=end_points.Start, EndPoint=construct_point)

# ----
curve = Curve(list_item)
panel = Panel(length)

# ---- group: 7.拾取道路起点，起点需要在第3步bake出来的网格的交点上
point = Point(Point(-1002.510664, 1185, -1311.923152))

# ---- group: 8.拾取道路终点，终点需要在第3步bake出来的网格的交点上
point_2 = Point(Point(-2396.811558, 0, -1372.289082))

# ----
line_3 = Line(StartPoint=point, EndPoint=point_2)
curve_middle = CurveMiddle(Curve=line_3)

number_slider = Slider(0, range=0..1)
上限是坡度最大值3_5倍 = Slider(0.33, range=0..4.5)
number_slider_2 = Slider(2012, range=0..5000)

curve_frame = CurveFrame(Curve=line_3, Parameter=curve_middle)
number_slider_3 = Slider(-45, range=-50..50)
number_slider_4 = Slider(0, range=-50..50)
deconstruct_plane = DeconstructPlane(Plane=curve_frame)  # -> Origin, XAxis, YAxis, ZAxis
multiplication = Multiplication(A=number_slider_3, B="10")
amplitude = Amplitude(Vector=deconstruct_plane.XAxis, Amplitude=multiplication)
multiplication_2 = Multiplication(A=number_slider_4, B="10")
amplitude_2 = Amplitude(Vector=deconstruct_plane.YAxis, Amplitude=multiplication_2)
move = Move(Geometry=curve_middle, Motion=amplitude_2)  # -> Geometry, Transform
move_2 = Move(Geometry=move.Geometry, Motion=amplitude)  # -> Geometry, Transform
deconstruct_mesh = DeconstructMesh(Mesh=mesh)  # -> Vertices, Faces, Colours, Normals
deconstruct_3 = Deconstruct(Point=deconstruct_mesh.Vertices)  # -> XComponent, YComponent, ZComponent
construct_point_2 = ConstructPoint(XCoordinate=deconstruct_3.XComponent, YCoordinate=deconstruct_3.YComponent, ZCoordinate=0)
distance = Distance(PointA=move_2.Geometry, PointB=construct_point_2)
min_max = MinMax(Number=distance)  # -> Minimum, Maximum
equality = Equality(FirstNumber=min_max.Minimum, SecondNumber=distance)  # -> Equality, Inequality
mass_addition = MassAddition(Input=equality.Equality)  # -> Result, PartialResults
panel_2 = Panel(mass_addition.Result)
dispatch = Dispatch(List=deconstruct_mesh.Vertices, DispatchPattern=equality.Equality)  # -> ListA, ListB
line_4 = Line(StartPoint=dispatch.ListA, EndPoint=point_2)
line_5 = Line(StartPoint=point, EndPoint=dispatch.ListA)

number_slider_5 = Slider(1, range=0..1)
deconstruct_4 = Deconstruct(Point=point)  # -> XComponent, YComponent, ZComponent

# ---- group: 4.构造多义路径的cost
angle = Angle(VectorA=removeduplicatelines, VectorB=line_2)  # -> Angle, Reflex
坡比 = Tangent(Value=angle.Angle)
# cost=max{length*1or0,0.01}*max{（X+坡比）}
length_2 = Length(Curve=removeduplicatelines)
addition = Addition(A=上限是坡度最大值3_5倍, B=坡比)

# ----
panel_3 = Panel(angle.Angle)
min_max_2 = MinMax(Number=坡比)  # -> Minimum, Maximum
multiplication_3 = Multiplication(A=length_2, B=number_slider)
random = Random(Range=min_max_2.Maximum, Number=1, Seed=number_slider_2)
maximum = Maximum(A=multiplication_3, B="0.01")
panel_4 = Panel(min_max_2.Maximum)
multiplication_4 = Multiplication(A=addition, B=number_slider_5)
panel_5 = Panel(random)
maximum_2 = Maximum(A=multiplication_4, B="0.01")

# ---- group: 4.构造多义路径的cost (continued)
multiplication_5 = Multiplication(A=maximum, B=addition)

# ----
maximum_3 = Maximum(A=multiplication_5, B="0.01")

shortest_walk = ShortestWalk(Curves=removeduplicatelines, Lengths=maximum_3, WantedPath=line_4)  # -> ShortestWalk, Succession, Direction, Length
pipe = Pipe(Curve=shortest_walk.ShortestWalk, Radius=Slider(2, range=0..100), Caps=0)
explode = Explode(Curve=shortest_walk.ShortestWalk, Recursive=True)  # -> Segments, Vertices
custom_preview = CustomPreview(Geometry=pipe, Material=ColourSwatch(SwatchColor=RGB(188, 40, 237)))

shortest_walk_2 = ShortestWalk(Curves=removeduplicatelines, Lengths=maximum_3, WantedPath=line_5)  # -> ShortestWalk, Succession, Direction, Length
pipe_2 = Pipe(Curve=shortest_walk_2.ShortestWalk, Radius=Slider(2, range=0..100), Caps=0)
explode_2 = Explode(Curve=shortest_walk_2.ShortestWalk, Recursive=True)  # -> Segments, Vertices
custom_preview_2 = CustomPreview(Geometry=pipe_2, Material=ColourSwatch(SwatchColor=RGB(188, 40, 237)))

# ---- group: 14按间距要求筛选点
希望的分段数 = Slider(8, range=0..50)
list_length = ListLength(List=explode.Vertices)
division = Division(A=list_length, B=希望的分段数)
series = Series(Start="0", Step=希望的分段数, Count=division)
subtraction = Subtraction(A=list_length, B="1")
merge = Merge(Data1=flatten(series), Data2=flatten(subtraction))
list_item_2 = ListItem(List=explode.Vertices, Index=merge, Wrap=True)

希望的分段数_2 = Slider(4, range=0..50)
list_length_2 = ListLength(List=explode_2.Vertices)
division_2 = Division(A=list_length_2, B=希望的分段数_2)
series_2 = Series(Start="0", Step=希望的分段数_2, Count=division_2)
subtraction_2 = Subtraction(A=list_length_2, B="1")
merge_2 = Merge(Data1=flatten(series_2), Data2=flatten(subtraction_2))
list_item_3 = ListItem(List=explode_2.Vertices, Index=merge_2, Wrap=True)

# ----
merge_3 = Merge(Data1=flatten(list_item_3), Data2=flatten(list_item_2))
removeduplicatepts = RemoveDuplicatePts(Points=merge_3, Tolerance=Slider(0.01, range=0..0.01))

polyline = PolyLine(Vertices=removeduplicatepts, Closed=False)
explode_3 = Explode(Curve=polyline, Recursive=True)  # -> Segments, Vertices
pipe_3 = Pipe(Curve=polyline, Radius=Slider(10, range=0..100), Caps=0)
custom_preview_3 = CustomPreview(Geometry=pipe_3, Material=ColourSwatch(SwatchColor=RGB(255, 255, 0)))

deconstruct_5 = Deconstruct(Point=removeduplicatepts)  # -> XComponent, YComponent, ZComponent
construct_point_3 = ConstructPoint(XCoordinate=deconstruct_5.XComponent, YCoordinate=deconstruct_5.YComponent, ZCoordinate=deconstruct_4.ZComponent)

# ---- group: 16.多个指标计算
end_points_2 = EndPoints(Curve=explode_3.Segments)  # -> Start, End
deconstruct_6 = Deconstruct(Point=end_points_2.Start)  # -> XComponent, YComponent, ZComponent
deconstruct_7 = Deconstruct(Point=end_points_2.End)  # -> XComponent, YComponent, ZComponent
construct_point_4 = ConstructPoint(XCoordinate=deconstruct_7.XComponent, YCoordinate=deconstruct_7.YComponent, ZCoordinate=deconstruct_6.ZComponent)
line_6 = Line(StartPoint=end_points_2.Start, EndPoint=construct_point_4)
angle_2 = Angle(VectorA=explode_3.Segments, VectorB=line_6)  # -> Angle, Reflex

# ----
merge_4 = Merge(Data1=polyline, Data2=mesh_edges.InteriorEdges)

# ---- group: 16.多个指标计算
# 01总长度
# 02平整度
# 03平均坡度
# 04 top5 average坡度
line_7 = Line(StartPoint=point, EndPoint=point_2)
length_3 = Length(Curve=flatten(line_7))
length_4 = Length(Curve=flatten(explode_3.Segments))
坡比_2 = Tangent(Value=angle_2.Angle)
sort_list = SortList(Keys=坡比_2)  # -> reverse(Keys), ValuesValuesA
split_list = SplitList(List=sort_list.Keys, Index=Slider(5, range=0..10))  # -> ListA, ListB
average = Average(Input=坡比_2)
average_2 = Average(Input=split_list.ListA)

# ----
curve_closest_point = CurveClosestPoint(Point=construct_point_3, Curve=line_7)  # -> Point, Parameter, Distance
min_max_3 = MinMax(Number=curve_closest_point.Distance)  # -> Minimum, Maximum
_02平整度 = Integer(min_max_3.Maximum)
panel_6 = Panel(_02平整度)
mass_addition_2 = MassAddition(Input=length_4)  # -> Result, PartialResults

# ---- group: 16.多个指标计算 (continued)
division_3 = Division(A=mass_addition_2.Result, B=length_3)

# ----
panel_7 = Panel(mass_addition_2.Result)
panel_8 = Panel(division_3)
wallacei_x = WallaceiX(
    Genes=[number_slider, number_slider_5, number_slider_2, number_slider_4, 上限是坡度最大值3_5倍, number_slider_3],
    Objectives=[mass_addition_2.Result, average, average_2, _02平整度],
    Phenotype=merge_4,
    allFitness="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",
    allFrontIdx="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",
    allGenomes="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",
    curFrontIdx="49|0;49|1;49|2;49|3;49|4;49|5;49|6;49|7;49|8;49|9;49|10;49|11;49|12;49|13;49|14;49|15;49|16;49|17;49|18;49|19;49|20;49|21;49|22;49|23;49|24;49|25;49|26;49|27;49|28;49|29;49|30;49|31;49|32;49|33;49|34;49|35;49|36;49|37;49|38;49|39",
    curFrontIdxSave="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",
    popGen="40,50",
    total="31909531",
    wlcDone=True)  # -> WallaceiGenomes, FitnessValues, Data, Phenotypes
panel_9 = Panel(average)
panel_10 = Panel(average_2)

number_slider_6 = Slider(2500, range=0..10000)
distribute_to_grid = DistributeToGrid(
    FitnessValues=wallacei_x.FitnessValues,
    WallaceiPhenotypes=wallacei_x.Phenotypes,
    SizeOfTheGridInTheXDirection=number_slider_6,
    SizeOfTheGridInTheYDirection=number_slider_6,
    OutputOptions=0)  # -> DistributedFitnessValues, DistributedData, DistributedGeometries, DistributedMeshes, DistributedNumbers, GridLocations
split_list_2 = SplitList(List=distribute_to_grid.DistributedGeometries, Index="1")  # -> ListA, ListB
curve_2 = Curve(split_list_2.ListA)
pipe_4 = Pipe(Curve=curve_2, Radius=Slider(10, range=0..100), Caps=0)
custom_preview_4 = CustomPreview(Geometry=pipe_4, Material=ColourSwatch(SwatchColor=RGB(255, 255, 0)))

decode_phenotype = DecodePhenotype(WallaceiPhenotype=wallacei_x.Phenotypes)  # -> GeometriesList, MeshesList, NumbersList, TextList
decode_genome = DecodeGenome(WallaceiGenome=wallacei_x.WallaceiGenomes)
path_mapper = PathMapper(decode_phenotype.GeometriesList, source="{A;B;C;D}", target="{A;B;C}")
panel_11 = Panel(decode_genome)
tree_statistics = TreeStatistics(Tree=path_mapper)  # -> Paths, Length, Count
tree_branch = TreeBranch(Tree=decode_genome, Path=tree_statistics.Paths, MaintainPaths=True)
panel_12 = Panel(tree_branch)
list_item_4 = ListItem(List=tree_branch, Index=Slider(4, range=0..10), Wrap=True)
panel_13 = Panel(list_item_4)
