# Grasshopper definition MRAAS_0.1.gh (Grasshopper 1.0.8)
# plug-ins: Heteroptera, Human, Moonlight, Wallacei, eleFront

divide_count = Slider(10, range=0..50)
rad = Slider(6, range=0..30)
mesh = Mesh(<mesh referenced from the Rhino model>)
start_point = Point(<point referenced from the Rhino model>)
end_point = Point(<point referenced from the Rhino model>)
unit_z = UnitZ(Factor=1)
moonlight = Moonlight(Mode=Toggle(True))
panel = Panel("""wlc_x
wlc_slope""")
expression = Expression(x=divide_count, Expression="x-1")
custom_preview = CustomPreview(Geometry=mesh, Material=ColourSwatch(SwatchColor=RGBA(92, 129, 150, 74)))
project_point = ProjectPoint(Point=start_point, Direction=unit_z, Geometry=mesh)  # -> Point, Index
project_point_2 = ProjectPoint(Point=end_point, Direction=unit_z, Geometry=mesh)  # -> Point, Index
vb = VBScript(count=expression, genelist=panel)  # -> out, A
# ---------- vb: VB usings ----------
Imports System.IO
Imports System.Linq
Imports System.Data
Imports System.Drawing
Imports System.Reflection
Imports System.Windows.Forms
Imports System.Xml
Imports System.Xml.Linq
Imports Microsoft.VisualBasic
Imports System.Runtime.InteropServices

Imports Rhino.DocObjects
Imports Rhino.Collections
Imports GH_IO
Imports GH_IO.Serialization
# ---------- vb: VB ----------
    For Each obj As IGH_DocumentObject In owner.OnPingDocument().Objects
      If (obj.ComponentGuid <> New Guid("{21553c44-ea62-475e-a8bb-62b2a3ee5ca5}")) Then Continue For
      If (obj.NickName Like genelist) Then
        CallByName(obj, "Count", CallType.Set, count)
        'CallByName(obj, "ExpireSolution", CallType.Method, False)
        Return
      End If
    Next

    Print("No matching Gene list object found")
# ---------- end vb ----------
line = Line(StartPoint=project_point.Point, EndPoint=project_point_2.Point)
deconstruct = Deconstruct(Point=project_point.Point)  # -> XComponent, YComponent, ZComponent
deconstruct_2 = Deconstruct(Point=project_point_2.Point)  # -> XComponent, YComponent, ZComponent
project = Project(Geometry=line, Plane=PlaneXY(0, 0, 0))  # -> Geometry, Transform
divide_curve = DivideCurve(Curve=line, Count=divide_count, Kinks=False)  # -> Points, Tangents, Parameters
subtraction = Subtraction(A=deconstruct_2.ZComponent, B=deconstruct.ZComponent)
length = Length(Curve=project.Geometry)
wlc_x = GeneList(Decimals=1, Maximum=300, Minimum=-300, Value=[-116.3, -25.4, 62.8, 212.4, -70.2, -77.9, -251.6, -51, -221.1])
wlc_slope = GeneList(Decimals=3, Maximum=0.08, Minimum=-0.08, Value=[0.017, -0.063, 0.078, 0.065, 0.026, 0.048, -0.076, 0.071, 0.041])
panel_2 = Panel("""0
-1""")
panel_3 = Panel(subtraction)
panel_4 = Panel(length)
cull_index = CullIndex(List=divide_curve.Points, Indices=panel_2, Wrap=True)
cull_index_2 = CullIndex(List=divide_curve.Parameters, Indices=panel_2, Wrap=True)
horizontal_frame = HorizontalFrame(Curve=line, Parameter=cull_index_2)
multiplication = Multiplication(A=length, B=Slider(3, range=0..10))
deconstruct_plane = DeconstructPlane(Plane=horizontal_frame)  # -> Origin, XAxis, YAxis, ZAxis
unit_vector = UnitVector(Vector=deconstruct_plane.YAxis)
multiplication_2 = Multiplication(A=unit_vector, B=wlc_x)
move = Move(Geometry=deconstruct_plane.Origin, Motion=multiplication_2)  # -> Geometry, Transform
project_2 = Project(Geometry=move.Geometry, Plane=PlaneXY(0, 0, 0))  # -> Geometry, Transform
deconstruct_3 = Deconstruct(Point=project_point_2.Point)  # -> XComponent, YComponent, ZComponent
merge = Merge(Data1=simplify(start_point), Data2=simplify(flatten(project_2.Geometry)), Data3=simplify(end_point))
deconstruct_4 = Deconstruct(Point=project_point.Point)  # -> XComponent, YComponent, ZComponent
polyline = PolyLine(Vertices=merge, Closed=False)
fillet = Fillet(Curve=polyline, Radius=rad)
subtraction_2 = Subtraction(A=deconstruct_3.ZComponent, B=deconstruct_4.ZComponent)
unit_z_2 = UnitZ(Factor=deconstruct_4.ZComponent)
explode = Explode(Curve=fillet, Recursive=True)  # -> Segments, Vertices
move_2 = Move(Geometry=explode.Segments, Motion=unit_z_2)  # -> Geometry, Transform
end_points = EndPoints(Curve=line)  # -> Start, End
filter_by_type = FilterByType(ObjectType="Arc", Geometry=move_2.Geometry, invertFilter=False, returnNulls=False)  # -> ExcludedGeometry, IncludedGeometry
deconstruct_5 = Deconstruct(Point=end_points.End)  # -> XComponent, YComponent, ZComponent
deconstruct_6 = Deconstruct(Point=end_points.Start)  # -> XComponent, YComponent, ZComponent
distance = Distance(PointA=start_point, PointB=end_point)
curve = Curve(filter_by_type.ExcludedGeometry)
subtraction_3 = Subtraction(A=deconstruct_5.ZComponent, B=deconstruct_6.ZComponent)
cull_index_3 = CullIndex(List=curve, Indices="-1", Wrap=True)
end_points_2 = EndPoints(Curve=curve)  # -> Start, End
panel_5 = Panel(subtraction_3)
panel_6 = Panel(distance)
length_2 = Length(Curve=cull_index_3)
multiplication_3 = Multiplication(A=length_2, B=wlc_slope)
cull_index_4 = CullIndex(List=end_points_2.Start, Indices="0", Wrap=True)
cull_index_5 = CullIndex(List=end_points_2.End, Indices="-1", Wrap=True)
mass_addition = MassAddition(Input=multiplication_3)  # -> Result, PartialResults
unit_z_3 = UnitZ(Factor=mass_addition.PartialResults)
move_3 = Move(Geometry=cull_index_4, Motion=unit_z_3)  # -> Geometry, Transform
move_4 = Move(Geometry=cull_index_5, Motion=unit_z_3)  # -> Geometry, Transform
move_5 = Move(Geometry=filter_by_type.IncludedGeometry, Motion=unit_z_3)  # -> Geometry, Transform
道路半宽 = Slider(2.5, range=0..10)
side_slope_x_1 = Panel("0.5")
精度 = Slider(2, range=0..5)
mesh_2 = Mesh(<mesh referenced from the Rhino model>)
curve_2 = Curve(<curve referenced from the Rhino model>)
insert_items = InsertItems(List=move_4.Geometry, Item=end_points.End, Indices="-1", Wrap=True)
insert_items_2 = InsertItems(List=move_3.Geometry, Item=end_points.Start, Indices="0", Wrap=True)
line_2 = Line(StartPoint=insert_items_2, EndPoint=insert_items)
list_item = ListItem(List=line_2, Index="-1", Wrap=True)
unit_z_4 = UnitZ(Factor=1)
join_curves = JoinCurves(Curves=flatten([line_2, move_5.Geometry]), Preserve=False)
project_3 = Project(Geometry=list_item, Plane=PlaneXY(0, 0, 0))  # -> Geometry, Transform
gene_pool_and_slider_shuffler = GenePoolAndSliderShuffler(BooleanButton=Button())
angle = Angle(VectorA=list_item, VectorB=project_3.Geometry)  # -> Angle, Reflex
angle_2 = Angle(VectorA=line_2, VectorB=curve)  # -> Angle, Reflex
absolute = Absolute(Value=angle.Angle)
average = Average(Input=angle_2.Angle)
number_slider = Slider(3, range=0..10)
larger_than = LargerThan(FirstNumber=absolute, SecondNumber="0.08")  # -> LargerThan, OrEqualTo

# ---- group: 坡度二次筛选组
dispatch = Dispatch(List=join_curves, DispatchPattern=larger_than.LargerThan)  # -> ListA, ListB

# ----
length_3 = Length(Curve=dispatch.ListB)
smaller_than = SmallerThan(FirstNumber=length_3, SecondNumber=multiplication)  # -> SmallerThan, OrEqualTo
dispatch_2 = Dispatch(List=dispatch.ListB, DispatchPattern=smaller_than.SmallerThan)  # -> ListA, ListB

curve_3 = Curve(dispatch_2.ListA)
project_4 = Project(Geometry=curve_3, Plane=PlaneXY(0, 0, 0))  # -> Geometry, Transform
divide_distance = DivideDistance(Curve=project_4.Geometry, Distance=精度)  # -> Points, Tangents, Parameters
end_points_3 = EndPoints(Curve=project_4.Geometry)  # -> Start, End
insert_items_3 = InsertItems(List=divide_distance.Points, Item=end_points_3.End, Indices="-1", Wrap=True)
project_point_3 = ProjectPoint(Point=insert_items_3, Direction=unit_z_4, Geometry=curve_3)  # -> Point, Index
point = Point(insert_items_3)
curve_closest_point = CurveClosestPoint(Point=project_point_3.Point, Curve=curve_3)  # -> Point, Parameter, Distance
polyline_2 = PolyLine(Vertices=point, Closed=False)
curve_closest_point_2 = CurveClosestPoint(Point=insert_items_3, Curve=polyline_2)  # -> Point, Parameter, Distance
horizontal_frame_2 = HorizontalFrame(Curve=curve_3, Parameter=curve_closest_point.Parameter)
deconstruct_plane_2 = DeconstructPlane(Plane=horizontal_frame_2)  # -> Origin, XAxis, YAxis, ZAxis
horizontal_frame_3 = HorizontalFrame(Curve=polyline_2, Parameter=curve_closest_point_2.Parameter)
unit_vector_2 = UnitVector(Vector=deconstruct_plane_2.YAxis)
expression_2 = Expression(x=angle.Angle, Expression="if(x>0.12, 999, x)")
project_5 = Project(Plane=PlaneXY(0, 0, 0))  # -> Geometry, Transform
deconstruct_plane_3 = DeconstructPlane(Plane=horizontal_frame_3)  # -> Origin, XAxis, YAxis, ZAxis
multiplication_4 = Multiplication(A=unit_vector_2, B=道路半宽)
unit_vector_3 = UnitVector(Vector=deconstruct_plane_3.YAxis)
division = Division(A="1", B=side_slope_x_1)
multiplication_5 = Multiplication(A=unit_vector_2, B=number_slider)
unit_vector_4 = UnitVector(Vector=deconstruct_plane_3.YAxis)
merge_2 = Merge(Data1=simplify(dispatch.ListB), Data2=simplify(mesh))  # -> flatten(Result)
move_6 = Move(Geometry=deconstruct_plane_2.Origin, Motion=multiplication_4)  # -> Geometry, Transform
move_7 = Move(Geometry=deconstruct_plane_2.Origin, Motion=expr("-x", multiplication_4))  # -> Geometry, Transform
last_slope = Number(flatten(expression_2))
unit_z_5 = UnitZ(Factor=1)
multiplication_6 = Multiplication(A=unit_vector_3, B=道路半宽)
multiplication_7 = Multiplication(A=division, B=number_slider)
multiplication_8 = Multiplication(A=unit_vector_4, B=number_slider)

polyline_3 = PolyLine(Vertices=move_6.Geometry, Closed=False)
polyline_4 = PolyLine(Vertices=move_7.Geometry, Closed=False)

move_8 = Move(Geometry=move_6.Geometry, Motion=multiplication_5)  # -> Geometry, Transform
panel_7 = Panel(expression_2)
unit_z_6 = UnitZ(Factor=multiplication_7)
move_9 = Move(Geometry=deconstruct_plane_3.Origin, Motion=expr("-x", multiplication_6))  # -> Geometry, Transform
move_10 = Move(Geometry=deconstruct_plane_3.Origin, Motion=multiplication_6)  # -> Geometry, Transform

multiplication_9 = Multiplication(A=unit_vector_4, B="50")
multiplication_10 = Multiplication(A=unit_vector_3, B="50")
move_11 = Move(Geometry=deconstruct_plane_3.Origin, Motion=expr("-x", multiplication_10))  # -> Geometry, Transform
move_12 = Move(Geometry=move_10.Geometry, Motion=multiplication_9)  # -> Geometry, Transform
line_3 = Line(StartPoint=move_12.Geometry, EndPoint=move_11.Geometry)

divide_length = DivideLength(Curve=line_3, Length="1.0")  # -> Points, Tangents, Parameters
project_point_4 = ProjectPoint(Point=divide_length.Points, Direction=unit_z_5, Geometry=mesh_2)  # -> Point, Index
move_13 = Move(Geometry=move_7.Geometry, Motion=expr("-x", multiplication_5))  # -> Geometry, Transform
unit_z_7 = UnitZ(Factor=multiplication_7)
unit_z_8 = UnitZ(Factor=multiplication_7)
move_14 = Move(Geometry=move_10.Geometry, Motion=multiplication_8)  # -> Geometry, Transform
polyline_5 = PolyLine(Vertices=project_point_4.Point, Closed=False)
polyline_6 = PolyLine(Vertices=move_10.Geometry, Closed=False)
polyline_7 = PolyLine(Vertices=move_9.Geometry, Closed=False)
move_15 = Move(Geometry=move_8.Geometry, Motion=expr("-x", unit_z_7))  # -> Geometry, Transform
move_16 = Move(Geometry=move_8.Geometry, Motion=unit_z_7)  # -> Geometry, Transform
move_17 = Move(Geometry=move_13.Geometry, Motion=unit_z_8)  # -> Geometry, Transform
move_18 = Move(Geometry=move_13.Geometry, Motion=expr("-x", unit_z_8))  # -> Geometry, Transform
move_19 = Move(Geometry=move_14.Geometry, Motion=unit_z_6)  # -> Geometry, Transform
flip_curve = FlipCurve(Curve=polyline_7)  # -> Curve, Flag
connect_curves = ConnectCurves(Curves=[polyline_6, flip_curve.Curve], Continuity=0, Close=True, Bulge=1)
line_4 = Line(StartPoint=move_10.Geometry, EndPoint=move_19.Geometry)
vector_2pt = Vector2Pt(PointA=graft(move_7.Geometry), PointB=graft(move_18.Geometry), Unitize=False)  # -> Vector, Length
vector_2pt_2 = Vector2Pt(PointA=graft(move_6.Geometry), PointB=graft(move_15.Geometry), Unitize=False)  # -> Vector, Length
vector_2pt_3 = Vector2Pt(PointA=graft(move_6.Geometry), PointB=graft(move_16.Geometry), Unitize=False)  # -> Vector, Length
vector_2pt_4 = Vector2Pt(PointA=graft(move_7.Geometry), PointB=graft(move_17.Geometry), Unitize=False)  # -> Vector, Length
line_5 = Line(StartPoint=move_6.Geometry, EndPoint=move_16.Geometry)
merge_3 = Merge(Data1=graft(move_6.Geometry), Data2=graft(move_7.Geometry))  # -> simplify(Result)
merge_4 = Merge(Data1=vector_2pt_2.Vector, Data2=vector_2pt_3.Vector, Data3=vector_2pt_4.Vector, Data4=vector_2pt.Vector)  # -> simplify(Result)
mesh_ray = MeshRay(Mesh=mesh_2, Point=merge_3, Direction=merge_4)  # -> Point, Hit
list_item_2 = ListItem(List=mesh_ray.Point, Index=0, Wrap=True)  # -> Item, Item1, Item2, Item3
clean_tree = CleanTree(RemoveNulls=True, RemoveInvalid=True, RemoveEmpty=False, Tree=list_item_2.Item)
clean_tree_2 = CleanTree(RemoveNulls=True, RemoveInvalid=True, RemoveEmpty=False, Tree=list_item_2.Item1)
clean_tree_3 = CleanTree(RemoveNulls=True, RemoveInvalid=True, RemoveEmpty=False, Tree=list_item_2.Item2)
clean_tree_4 = CleanTree(RemoveNulls=True, RemoveInvalid=True, RemoveEmpty=False, Tree=list_item_2.Item3)
line_6 = Line(StartPoint=move_6.Geometry, EndPoint=move_7.Geometry)
point_2 = Point(clean_tree)
curve_closest_point_3 = CurveClosestPoint(Point=point_2, Curve=polyline_5)  # -> Point, Parameter, Distance
shatter = Shatter(Curve=polyline_5, Parameters=curve_closest_point_3.Parameter)
list_item_3 = ListItem(List=shatter, Index=0, Wrap=True)  # -> Item, Item1
point_3 = Point(clean_tree_2)
curve_closest_point_4 = CurveClosestPoint(Point=point_3, Curve=polyline_5)  # -> Point, Parameter, Distance
shatter_2 = Shatter(Curve=polyline_5, Parameters=curve_closest_point_4.Parameter)
list_item_4 = ListItem(List=shatter_2, Index=0, Wrap=True)  # -> Item, Item1
point_4 = Point(clean_tree_3)
curve_closest_point_5 = CurveClosestPoint(Point=point_4, Curve=list_item_4.Item1)  # -> Point, Parameter, Distance
shatter_3 = Shatter(Curve=list_item_4.Item1, Parameters=curve_closest_point_5.Parameter)
point_5 = Point(clean_tree_4)
curve_closest_point_6 = CurveClosestPoint(Point=point_5, Curve=list_item_3.Item1)  # -> Point, Parameter, Distance
shatter_4 = Shatter(Curve=list_item_3.Item1, Parameters=curve_closest_point_6.Parameter)
list_item_5 = ListItem(List=shatter_4, Index=0, Wrap=True)
end_points_4 = EndPoints(Curve=flatten(list_item_5))  # -> Start, End
point_6 = Point(move_6.Geometry)
point_7 = Point(move_7.Geometry)
list_item_6 = ListItem(List=shatter_3, Index=0, Wrap=True)
end_points_5 = EndPoints(Curve=flatten(list_item_6))  # -> Start, End
line_7 = Line(StartPoint=end_points_4.End, EndPoint=move_7.Geometry)
line_8 = Line(StartPoint=end_points_4.Start, EndPoint=move_6.Geometry)
line_9 = Line(StartPoint=end_points_5.Start, EndPoint=point_6)
line_10 = Line(StartPoint=end_points_5.End, EndPoint=point_7)
merge_5 = Merge(Data1=simplify(list_item_5), Data2=simplify(graft(line_6)), Data3=simplify(graft(line_8)), Data4=simplify(graft(line_7)))
merge_6 = Merge(
    Data1=simplify(list_item_6),
    Data2=simplify(graft(line_6)),
    Data3=simplify(graft(line_9)),
    Data4=simplify(graft(line_10)))
merge_7 = Merge(Data1=line_8, Data2=line_7)
merge_8 = Merge(Data1=line_9, Data2=line_10)
join_curves_2 = JoinCurves(Curves=merge_6, Preserve=False)  # -> flatten(Curves)
join_curves_3 = JoinCurves(Curves=merge_5, Preserve=False)  # -> flatten(Curves)
closed = Closed(Curve=join_curves_2)  # -> Closed, Periodic
closed_2 = Closed(Curve=join_curves_3)  # -> Closed, Periodic
dispatch_3 = Dispatch(List=join_curves_3, DispatchPattern=closed_2.Closed)  # -> ListA, ListB
dispatch_4 = Dispatch(List=join_curves_2, DispatchPattern=closed.Closed)  # -> ListA, ListB
curve_4 = Curve([polyline_3, polyline_4])
planarize_curve = PlanarizeCurve(Curve=dispatch_3.ListA)  # -> PlanarCurve, Plane, Deviation

# ---- group: Plugin
planarize_curve_2 = PlanarizeCurve(Curve=dispatch_4.ListA)  # -> PlanarCurve, Plane, Deviation

# ----
custom_preview_lineweights = CustomPreviewLineweights(Geometry=curve_4, Shader=ColourSwatch(SwatchColor=RGB(255, 255, 255)), Thickness=Slider(3, range=0..10), Absolute=False)
number_slider_2 = Slider(2, range=0..10)
curve_5 = Curve(planarize_curve.PlanarCurve)
curve_6 = Curve(planarize_curve_2.PlanarCurve)
area = Area(Geometry=curve_5)  # -> Area, Centroid
area_2 = Area(Geometry=curve_6)  # -> Area, Centroid
custom_preview_lineweights_2 = CustomPreviewLineweights(Geometry=merge_7, Shader=ColourSwatch(SwatchColor=RGB(0, 246, 255)), Thickness=number_slider_2, Absolute=False)
custom_preview_lineweights_3 = CustomPreviewLineweights(Geometry=merge_8, Shader=ColourSwatch(SwatchColor=RGB(255, 0, 0)), Thickness=number_slider_2, Absolute=False)
mass_addition_2 = MassAddition(Input=area_2.Area)  # -> Result, PartialResults
mass_addition_3 = MassAddition(Input=area.Area)  # -> Result, PartialResults
multiplication_11 = Multiplication(A=mass_addition_2.Result, B=精度)
multiplication_12 = Multiplication(A=mass_addition_3.Result, B=精度)
subtraction_4 = Subtraction(A=multiplication_11, B=multiplication_12)
absolute_2 = Absolute(Value=subtraction_4)
net_cutfill = Number(flatten(absolute_2))
addition = Addition(A=multiplication_12, B=multiplication_11)

# ---- group: 总挖填方量二次筛选组
smaller_than_2 = SmallerThan(FirstNumber=addition, SecondNumber="3000000")  # -> SmallerThan, OrEqualTo
dispatch_5 = Dispatch(List=dispatch_2.ListA, DispatchPattern=smaller_than_2.SmallerThan)  # -> ListA, ListB
curve_7 = Curve(dispatch_5.ListA)

# ----
explode_2 = Explode(Curve=curve_7, Recursive=True)  # -> Segments, Vertices
filter_by_type_2 = FilterByType(ObjectType="Arc", Geometry=explode_2.Segments, invertFilter=False, returnNulls=False)  # -> ExcludedGeometry, IncludedGeometry
project_6 = Project(Geometry=filter_by_type_2.ExcludedGeometry, Plane=PlaneXY(0, 0, 0))  # -> Geometry, Transform
length_4 = Length(Curve=curve_7)
angle_3 = Angle(VectorA=filter_by_type_2.ExcludedGeometry, VectorB=project_6.Geometry)  # -> Angle, Reflex
average_2 = Average(Input=length_4)
average_3 = Average(Input=angle_3.Angle)
rd_length = Number(flatten(average_2))
avg_slope = Number(flatten(average_3))
填方量 = Panel(multiplication_12)
净土方量 = Panel(subtraction_4)
总土方量 = Panel(addition)
total_cutfill = Number(flatten(总土方量))

# ---- group: 电池连错了跑废了
wallacei_x = WallaceiX(
    Genes=[wlc_x, wlc_slope],
    Objectives=[rd_length, avg_slope, total_cutfill, net_cutfill],
    allFitness="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",
    allFrontIdx="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",
    allGenomes="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",
    curFrontIdx="99|0;99|1;99|2;99|3;99|4;99|5;99|6;99|7;99|8;99|9;99|10;99|11;99|12;99|13;99|14;99|15;99|16;99|17;99|18;99|19;99|20;99|21;99|22;99|23;99|24;99|25;99|26;99|27;99|28;99|29;99|30;99|31;99|32;99|33;99|34;99|35;99|36;99|37;99|38;99|39;99|40;99|41;99|42;99|43;99|44;99|45;99|46;99|47;99|48;99|49",
    curFrontIdxSave="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",
    popGen="50,100",
    total="11502906",
    wlcDone=True)  # -> WallaceiGenomes, FitnessValues, Data, Phenotypes

# ---- group: 5000，第二次
wallacei_x_2 = WallaceiX(
    Genes=[wlc_x, wlc_slope],
    Objectives=[rd_length, avg_slope, total_cutfill, net_cutfill],
    Data=dispatch.ListB,
    allFitness="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",
    allFrontIdx="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",
    allGenomes="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",
    curFrontIdx="99|0;99|1;99|2;99|3;99|4;99|5;99|6;99|7;99|8;99|9;99|10;99|11;99|12;99|13;99|14;99|15;99|16;99|17;99|18;99|19;99|20;99|21;99|22;99|23;99|24;99|25;99|26;99|27;99|28;99|29;99|30;99|31;99|32;99|33;99|34;99|35;99|36;99|37;99|38;99|39;99|40;99|41;99|42;99|43;99|44;99|45;99|46;99|47;99|48;99|49",
    curFrontIdxSave="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",
    popGen="50,100",
    total="16791797",
    wlcDone=True)  # -> WallaceiGenomes, FitnessValues, Data, Phenotypes

# ---- group: 5000广搜
wallacei_x_3 = WallaceiX(
    Genes=[wlc_x, wlc_slope],
    Objectives=[rd_length, avg_slope, total_cutfill, net_cutfill],
    allFitness="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",
    allGenomes="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",
    curFrontIdx="0|2;0|5;0|11;0|20;0|21;0|28;0|30;0|50;0|61;0|65;0|79;0|88;0|95;0|103;0|122;0|150;0|160;0|162;0|166;0|190;0|216;0|228;0|232;0|236;0|243;0|249;0|252;0|253;0|262;0|278;0|279;0|286;0|293;0|311;0|312;0|333;0|367;0|379;0|384;0|388;0|389;0|395;0|403;0|407;0|429;0|431;0|438",
    curFrontIdxSave="0|2;0|5;0|11;0|20;0|21;0|28;0|30;0|50;0|61;0|65;0|79;0|88;0|95;0|103;0|122;0|150;0|160;0|162;0|166;0|190;0|216;0|228;0|232;0|236;0|243;0|249;0|252;0|253;0|262;0|278;0|279;0|286;0|293;0|311;0|312;0|333;0|367;0|379;0|384;0|388;0|389;0|395;0|403;0|407;0|429;0|431;0|438",
    popGen="5000,0",
    total="0",
    wlcDone=False)  # -> WallaceiGenomes, FitnessValues, Data, Phenotypes

# ----
挖方量 = Panel(multiplication_11)
